# Dynamo graph testing_01.dyn (Dynamo 1.3.0.875)

file_path = Filename("meshes\saddle.obj")
compasNetworkFromObj = Compas.Dynamo.Datastructures.CompasNetwork.CompasNetworkFromObj(file_path)
wpf = CustomUIWpfNodeModel()  # "Essentials.CustomUI.Wpf"
smooth = Compas.Dynamo.Datastructures.CompasNetwork.Smooth(compasNetworkFromObj, wpf)
integer_slider = IntegerSlider(10, range=0..100 step 1)
wpfState = CustomUINodeModelWpfState()  # "Essentials.CustomUI.WpfState"
